# Grasshopper definition metaballTable.gh (Grasshopper 1.0.7)
# plug-ins: Kangaroo2 Components, LunchBox

pt = Point([Point(952.7796046, 276.9936122, 0), Point(559.5664962, -190.4364572, 0), Point(533.7566661, 572.6267411, 0)])
points2 = GetPoint(pt, AtLeast=1, AtMost=2147483647, Realtime=True)
interpolate = Interpolate(Vertices=points2, Degree=3, Periodic=False, KnotStyle=1)  # -> Curve, Length, Domain
number_slider = Slider(350, range=350..1000)  # disabled
number_slider_2 = Slider(800, range=350..1000)  # disabled
scale = Panel("0.1")  # disabled
# BRAÇOS
colour_swatch = ColourSwatch(SwatchColor=RGB(255, 0, 0))
pt_2 = Point([Point(279, 218, 0), Point(-181, 218, 0), Point(49, -212, 0)])  # disabled
height = GetNumber(number_slider, AtLeast=1, AtMost=2147483647, Maximum=1.797693135e+308, Minimum=-1.797693135e+308)  # disabled
c_script = CSharpScript(crv=interpolate.Curve, color=colour_swatch)  # -> out, A; inputs crv: Curve, color: Color; disabled
# ---------- c_script: C# ----------
    var c = color.R + "," + color.G + "," + color.B;
    crv.SetUserString("color", c);
    A = crv;
# ---------- end c_script ----------
points = GetPoint(pt_2, AtLeast=1, AtMost=2147483647, Realtime=True)  # disabled
dimension = GetNumber(number_slider_2, AtLeast=1, AtMost=2147483647, Maximum=1.797693135e+308, Minimum=-1.797693135e+308)  # disabled
pt_3 = Point([Point(279, 218, 0), Point(-181, 218, 0), Point(49, -212, 0)])
dom = ConstructDomain(DomainStart=expr("-x/2", dimension), DomainEnd=expr("x/2", dimension))  # disabled
Z = UnitZ(Factor=height)  # disabled

unit_y = UnitY(Factor=1)  # disabled
number_slider_3 = Slider(0, range=0..30)  # disabled
multiplication = Multiplication(A=unit_y, B=number_slider_3)  # disabled
move = Move(Motion=multiplication)  # -> Geometry, Transform; disabled
slider = Slider(0.1, range=0..10)  # disabled
slider_2 = Slider(0.1, range=0..10)  # disabled
construct_domain = Domain(DomainStart=expr("-x/2", slider), DomainEnd=expr("x/2", slider))  # disabled
construct_domain_2 = Domain(DomainStart=expr("-x/2", slider_2), DomainEnd=expr("x/2", slider_2))  # disabled
rectangle = Rectangle(Plane=PlaneXY(0, 0, 0), XSize=construct_domain, YSize=construct_domain_2, Radius=0)  # -> Rectangle, Length; disabled
number_slider_4 = Slider(1, range=0..1)  # disabled
perp_frame = PerpFrame(Curve=move.Geometry, Parameter=number_slider_4)  # disabled
xy_plane = XYPlane(Origin=Point(0, 0, 0))  # disabled
orient = Orient(Geometry=rectangle.Rectangle, Source=xy_plane, Target=perp_frame)  # -> Geometry, Transform; disabled
sweep1 = Sweep1(Rail=move.Geometry, Sections=orient.Geometry, Miter=1)  # disabled

points_2 = GetPoint(pt_3, AtLeast=1, AtMost=2147483647, Realtime=True)
# BRAÇOS
interpolate_2 = Interpolate(Vertices=points_2, Degree=3, Periodic=False, KnotStyle=1)  # -> Curve, Length, Domain
rectangle_2 = Rectangle(Plane=PlaneXY(0, 0, 0), XSize=dom, YSize=dom, Radius=0)  # -> Rectangle, Length; disabled
interpolate_3 = Interpolate(Vertices=points, Degree=3, Periodic=False, KnotStyle=1)  # -> Curve, Length, Domain; disabled
move_2 = Move(Geometry=rectangle_2.Rectangle, Motion=Z)  # -> Geometry, Transform; disabled
number_slider_5 = Slider(100, range=0..100)  # disabled

# ---- group: RH_OUT:limit
crv = Curve(rectangle_2.Rectangle)  # disabled

# ----
c_script_2 = CSharpScript(crv=interpolate_2.Curve, color=ColourSwatch(SwatchColor=RGB(255, 0, 0)))  # -> out, A; inputs crv: Curve, color: Color; same code as c_script
unit_z = UnitZ(Factor=number_slider_5)  # disabled
move_3 = Move(Geometry=interpolate_3.Curve, Motion=unit_z)  # -> Geometry, Transform; disabled
curve = Curve(reparameterize(interpolate.Curve))
scale_2 = Scale(Geometry=points, Center=Point(0, 0, 0), Factor=scale)  # -> Geometry, Transform; disabled
scale_3 = Scale(Geometry=move_2.Geometry, Center=Point(0, 0, 0), Factor=scale)  # -> Geometry, Transform; disabled
panel = Panel("10")  # disabled

# ---- group: RH_OUT:curve
curve_2 = Curve(reparameterize(c_script_2.A))

# ----
pop2d = Populate2D(Region=scale_3.Geometry, Count=panel, Seed=1)  # disabled

# ---- group: RH_OUT:spline
curve_3 = Curve(move_3.Geometry)  # disabled

# ----
item = ListItem(List=pop2d, Index=0, Wrap=True)  # disabled
cp = ClosestPoint(Point=scale_2.Geometry, Cloud=pop2d)  # -> ClosestPoint, CPIndex, Distance; disabled
number_slider_6 = Slider(17, range=5..25)  # disabled
dimension_2 = GetNumber(Slider(10, range=0..10), AtLeast=1, AtMost=2147483647, Maximum=1.797693135e+308, Minimum=-1.797693135e+308)
pdecon = Deconstruct(Point=item)  # -> XComponent, YComponent, ZComponent; disabled
construct_domain_3 = Domain(DomainStart=expr("-x/2", dimension_2), DomainEnd=expr("x/2", dimension_2))
construct_domain_4 = Domain(DomainStart=expr("-x/2", dimension_2), DomainEnd=expr("x/2", dimension_2))
ln = Line(StartPoint=cp.ClosestPoint, EndPoint=scale_2.Geometry)  # disabled
panel_2 = Panel("0")  # disabled
panel_3 = Panel("10")  # disabled
range = Range(Domain=pdecon.ZComponent, Steps=number_slider_6)  # disabled
ext = ExtendCurve(Curve=ln, Type=0, Start=panel_2, End=panel_3)  # disabled
rectangle_3 = Rectangle(Plane=PlaneXY(0, 0, 0), XSize=construct_domain_4, YSize=construct_domain_3, Radius=0)  # -> Rectangle, Length
item_2 = ListItem(List=reverse(range), Index=0, Wrap=True)  # disabled
number_slider_7 = Slider(39.123, range=0..100)  # disabled
number_slider_8 = Slider(2.212, range=0..100)  # disabled
divide = DivideCurve(Curve=ext, Count=10, Kinks=False)  # -> flatten(Points), Tangents, Parameters; disabled
perp_frame_2 = PerpFrame(Curve=curve_2, Parameter=Slider(1, range=0..1))
xy_plane_2 = XYPlane(Origin=Point(0, 0, 0))
lng = ListLength(List=divide.Points)  # disabled
orient_2 = Orient(Geometry=rectangle_3.Rectangle, Source=xy_plane_2, Target=perp_frame_2)  # -> Geometry, Transform
dup = DuplicateData(Data=number_slider_7, Number=panel, Order=True)  # disabled
dup_2 = DuplicateData(Data=number_slider_8, Number=lng, Order=True)  # disabled
pt_4 = ConstructPoint(XCoordinate=0, YCoordinate=0, ZCoordinate=range)  # disabled
bool = Boolean(lng)  # disabled
sweep1_2 = Sweep1(Rail=curve_2, Sections=orient_2.Geometry, Miter=1)
number_slider_9 = Slider(0.506, range=0..1)  # disabled
merge = Merge(Data1=flatten(divide.Points), Data2=flatten(pop2d))  # disabled
merge_2 = Merge(Data1=dup_2, Data2=dup)  # disabled
brep = Brep(sweep1_2)
area = Area(Geometry=brep)  # -> Area, Centroid
filter = StreamFilter(Gate=bool, Stream1=merge_2)  # disabled
area_2 = Area(Geometry=sweep1)  # -> Area, Centroid; disabled
xz_plane = XZPlane(Origin=Point(0, 0, 0))
list_item = ListItem(List=area.Centroid, Index=0, Wrap=True)
panel_4 = Panel("10")  # disabled
metaball_t = MetaBallTCustom(Points=merge, Charge=filter, Plane=pt_4, Threshold=number_slider_9)  # disabled
list_item_2 = ListItem(List=area_2.Centroid, Index=0, Wrap=True)  # disabled
xz_plane_2 = XZPlane(Origin=Point(0, 0, 0))  # disabled
scale_4 = Scale(Geometry=metaball_t, Center=Point(0, 0, 0), Factor=panel_4)  # -> Geometry, Transform; disabled
number_slider_10 = Slider(90, range=0..360)  # disabled
negative = Negative(Value=Slider(90, range=0..360))
negative_2 = Negative(Value=number_slider_10)  # disabled
crv_2 = Curve(simplify(scale_4.Geometry))  # disabled
explode = Explode(Curve=crv_2, Recursive=True)  # -> flatten(Segments), Vertices; disabled
rotate_3d = Rotate3D(Geometry=brep, Angle=degrees(negative), Center=list_item, Axis=xz_plane)  # -> Geometry, Transform
rotate_3d_2 = Rotate3D(Geometry=brep, Angle=degrees(negative_2), Center=list_item_2, Axis=xz_plane_2)  # -> Geometry, Transform; disabled
dupln = RemoveDuplicateLines(Lines=explode.Segments, Tolerance=0.01)  # disabled
join = JoinCurves(Curves=dupln, Preserve=False)  # disabled
height_2 = GetNumber(Slider(247, range=0..1000), AtLeast=1, AtMost=2147483647, Maximum=1.797693135e+308, Minimum=-1.797693135e+308)
unit_x = UnitX(Factor=height_2)
unit_x_2 = UnitX(Factor=height_2)  # disabled
redpline = Reduce(Polyline=join, Tolerance=1)  # -> Polyline, Reduction; disabled
move_4 = Move(Geometry=rotate_3d.Geometry, Motion=unit_x)  # -> Geometry, Transform
move_5 = Move(Geometry=rotate_3d_2.Geometry, Motion=unit_x_2)  # -> Geometry, Transform; disabled
midpt = CurveMiddle(Curve=redpline.Polyline)  # disabled
pdecon_2 = Deconstruct(Point=midpt)  # -> XComponent, YComponent, ZComponent; disabled
bnd = Bounds(Numbers=pdecon_2.ZComponent)  # disabled
dedomain = DeconstructDomain(Domain=bnd)  # -> Start, End; disabled
gradient = Gradient(
    LowerLimit=0,
    UpperLimit=dedomain.End,
    Parameter=pdecon_2.ZComponent,
    stops=[0.125: RGB(0, 0, 0), 0.499: RGB(255, 251, 0), 0.868: RGB(255, 0, 255)])  # disabled
point = Point(Point(758.5714475, -110.7288715, 0))
point_2 = Point(Point(758.5714475, -110.7288715, 0))  # disabled
c_script_3 = CSharpScript(crv=redpline.Polyline, color=gradient)  # -> out, A; inputs crv: Curve, color: Color; disabled; same code as c_script
vector_2pt = Vector2Pt(PointA=area.Centroid, PointB=point, Unitize=False)  # -> Vector, Length
vector_2pt_2 = Vector2Pt(PointA=area_2.Centroid, PointB=point_2, Unitize=False)  # -> Vector, Length; disabled
preview = CustomPreview(Geometry=redpline.Polyline, Material=gradient)  # disabled

# ---- group: RH_OUT:crvs
crv_3 = Curve(c_script_3.A)  # disabled

# ----
move_6 = Move(Geometry=[move_4.Geometry, rotate_3d.Geometry], Motion=vector_2pt.Vector)  # -> Geometry, Transform
move_7 = Move(Geometry=[move_5.Geometry, rotate_3d_2.Geometry], Motion=vector_2pt_2.Vector)  # -> Geometry, Transform; disabled

# ---- group: RH_OUT:mesh
mesh = Mesh(move_6.Geometry)

# ----
# COSTAS E ASSENTO
construct_domain_5 = Domain(DomainStart=expr("-x/2", dimension_2), DomainEnd=expr("x/2", dimension_2))
construct_domain_6 = Domain(DomainStart=expr("-x/2", dimension_2), DomainEnd=expr("x/2", dimension_2))
rectangle_4 = Rectangle(Plane=PlaneXY(0, 0, 0), XSize=construct_domain_5, YSize=construct_domain_6, Radius=0)  # -> Rectangle, Length
perp_frame_3 = PerpFrame(Curve=curve, Parameter=Slider(1, range=0..1))
xy_plane_3 = XYPlane(Origin=Point(0, 0, 0))
orient_3 = Orient(Geometry=rectangle_4.Rectangle, Source=xy_plane_3, Target=perp_frame_3)  # -> Geometry, Transform
sweep1_3 = Sweep1(Rail=curve, Sections=orient_3.Geometry, Miter=1)
series = Series(Start=Slider(0, range=0..10), Step=dimension_2, Count=Slider(10, range=0..10000))
unit_x_3 = UnitX(Factor=series)

area_3 = Area(Geometry=sweep1_3)  # -> Area, Centroid

rotate_3d_3 = Rotate3D(Geometry=sweep1_3, Angle=degrees(negative), Center=area_3.Centroid, Axis=xz_plane)  # -> Geometry, Transform
move_8 = Move(Geometry=rotate_3d_3.Geometry, Motion=unit_x_3)  # -> Geometry, Transform

# ---- group: RH_OUT_mesh2
mesh_2 = Mesh(move_8.Geometry)

# ----
# PLANIFICACAO
number_slider_11 = Slider(30, range=0..100)  # disabled
number_slider_12 = Slider(4, range=0..100)  # disabled
number_slider_13 = Slider(6, range=0..100)  # disabled
list_item_3 = ListItem(List=move_8.Geometry, Index=0, Wrap=True)  # disabled
rectangle_5 = Rectangle(Plane=PlaneXY(0, 0, 0), XSize=number_slider_11, YSize=number_slider_11, Radius=0)  # -> Rectangle, Length; disabled
area_4 = Area(Geometry=list_item_3)  # -> Area, Centroid; disabled
grid_structure = GridStructure(Surface=rectangle_5.Rectangle, UDivisions=number_slider_12, VDivisions=number_slider_13)  # -> StructureLines, StructureNodes; disabled
yz_plane = YZPlane(Origin=area_4.Centroid)  # disabled
layout_points = Point(grid_structure.StructureNodes)  # disabled
short = ShortestList(ListA=move_8.Geometry, ListB=layout_points, TrimMode=2)  # -> ListA, ListB; disabled
orient_4 = Orient(Geometry=move_8.Geometry, Source=yz_plane, Target=short.ListB)  # -> Geometry, Transform; disabled

number_slider_14 = Slider(20, range=0..100)  # disabled
number_slider_15 = Slider(0.662, range=0..1)  # disabled
series_2 = Series(Start=0, Step=1, Count=number_slider_14)  # disabled
tag = TextTag3D(Location=short.ListB, Text=series_2, Size=number_slider_15, Justification=8)  # disabled
